# Grasshopper definition winecooler.gh (Grasshopper 1.0.7)

number_slider = Slider(75, range=0..1000)
pt = Point(<point referenced from the Rhino model>)
cir = Circle(Plane=pt, Radius=number_slider)
cyl = Cylinder(Base=pt, Radius=number_slider, Length=Slider(160, range=0..1000))
srf = Surface(cyl)
srf_2 = Surface(cir)
merge = Merge(Data1=srf_2, Data2=srf)
srf_3 = Surface(merge)
